# Grasshopper definition InputExamples.gh (Grasshopper 1.0.5)
# plug-ins: Hummingbird

# ----
# Floors:
# 
# Each input curve must be a closed planer curve in Rhino.
# 
# Each such curve will create one floor object.
# 
# The input curves cannot be a single closed loop.  This means that they must be the join of
# at least two separate curves.
# Note the use of Graft on the Floors input so that the individual floors are kept separate.
# Example 1:  Closed Polylines.
ex_1_floors = Text("Ex 1 Floors")
l1_polyline = Curve(<curve referenced from the Rhino model>)
l2_polyline = Curve(<curve referenced from the Rhino model>)
explode = Explode(Curve=l2_polyline, Recursive=True)  # -> Segments, Vertices
panel = Panel(explode.Segments)
c_temp = Text("C:\Temp")
floors = Floors(WriteToggle=Button(), FolderPath=c_temp, CsvFileName=ex_1_floors, DataTreeSource=graft([l1_polyline, l2_polyline]))  # -> Output, Data
panel_2 = Panel(floors.Data)
panel_3 = Panel([l1_polyline, l2_polyline])

# ----
# Note the use of Graft on the Floors input so that the individual floors are kept separate.
# Example 2:  Splines.
ex_2_floors = Text("Ex 2 Floors")
l2_spline_and_line = Curve([<curve referenced from the Rhino model> x2])
l1_two_splines = Curve([<curve referenced from the Rhino model> x2])
panel_4 = Panel(l2_spline_and_line)
join = JoinCurves(Curves=l1_two_splines, Preserve=False)
join_2 = JoinCurves(Curves=l2_spline_and_line, Preserve=False)
panel_5 = Panel([join_2, join])
c_temp_2 = Text("C:\Temp")
floors_2 = Floors(WriteToggle=Button(), FolderPath=c_temp_2, CsvFileName=ex_2_floors, DataTreeSource=graft([join, join_2]))  # -> Output, Data
explode_2 = Explode(Curve=[join, join_2], Recursive=True)  # -> Segments, Vertices
panel_6 = Panel(floors_2.Data)
panel_7 = Panel(explode_2.Segments)

# ----
# Example 3:  Splines in Grasshopper.
# This example uses a closed polyline in Rhino to generate points.  The start points of the line segments are used to create an open spline and a separate closure line in Grasshopper.
ex_3_floors = Text("Ex 3 Floors")
l1_l2_plines = Curve([<curve referenced from the Rhino model> x2])
explode_3 = Explode(Curve=l1_l2_plines, Recursive=True)  # -> Segments, Vertices
end = EndPoints(Curve=explode_3.Segments)  # -> Start, End
nurbs = NurbsCurve(Vertices=end.Start, Degree=3, Periodic=False)  # -> Curve, Length, Domain
end_2 = EndPoints(Curve=nurbs.Curve)  # -> Start, End
ln = Line(StartPoint=end_2.Start, EndPoint=end_2.End)
c_temp_3 = Text("C:\Temp")
join_3 = JoinCurves(Curves=[nurbs.Curve, ln], Preserve=False)
floors_3 = Floors(WriteToggle=Button(), FolderPath=c_temp_3, CsvFileName=ex_3_floors, DataTreeSource=join_3)  # -> Output, Data
panel_8 = Panel(join_3)
panel_9 = Panel(floors_3.Data)

# ----
# Example 4:  Sections Through Breps.
# This example uses section slices through two brep surfaces in Rhino to create closed planer curves in Grasshopper. It is necessary that there are at least two brep surfaces so that the resultant curves are not a single closed spline.  The breps together must create closed loops.
# These elements use a bounding box to get a range to use to create the floor levels.
ex_4_floors = Text("Ex 4 Floors")
brep = Brep([<brep referenced from the Rhino model> x2])
panel_10 = Panel(brep)
no_of_levels = Integer(5)
join_4 = BrepJoin(Breps=brep)  # -> Breps, Closed
bbox = BoundingBox(Content=join_4.Breps, Plane=PlaneXY(0, 0, 0))  # -> Box, Box_2
debox = DeconstructBox(Box=bbox.Box)  # -> Plane, X, Y, Z
panel_11 = Panel(join_4.Breps)
range = Range(Domain=debox.Z, Steps=no_of_levels)
Z = UnitZ(Factor=range)
xy = XYPlane(Origin=Z)
sec = BrepPlane(Brep=join_4.Breps, Plane=xy)  # -> Curves, Points
c_temp_4 = Text("C:\Temp")
floors_4 = Floors(WriteToggle=Button(), FolderPath=c_temp_4, CsvFileName=ex_4_floors, DataTreeSource=sec.Curves)  # -> Output, Data
panel_12 = Panel(floors_4.Data)
panel_13 = Panel(sec.Curves)
