# Grasshopper definition AllComponentsProof.gh (Grasshopper 1.0.7)
# plug-ins: Hummingbird

# ----
# Levels
toggle = BooleanToggle(True)
_15 = Number(15)
c_temp = Text("C:\Temp")
_03_levels_test = Text("03 Levels Test")
level = Text("LEVEL ")
series = Series(Start=0, Step=_15, Count=10)
concat = Concatenate(FragmentA=level, FragmentB=series)
levels = Levels(WriteToggle=toggle, FolderPath=c_temp, CsvFileName=_03_levels_test, LevelElevation=series, LevelName=concat)  # -> Output, Data
panel = Panel(levels.Output)
panel_2 = Panel(levels.Data)

# ----
# Rooms and Areas
toggle_2 = BooleanToggle(True)
_30 = Number(30)
_20 = Number(20)
c_temp_2 = Text("C:\Temp")
name = Text("Name")
room = Text("ROOM ")
_9 = Number(9)
_05_rooms_test = Text("05 Rooms Test")
series_2 = Series(Start=_30, Step=_20, Count=_9)
concat_2 = Concatenate(FragmentA=room, FragmentB=series_2)  # -> graft(Result)
pt = ConstructPoint(XCoordinate=series_2, YCoordinate=series_2, ZCoordinate=0)  # -> graft(Point)
rooms_areas = RoomsAreas(
    WriteToggle=toggle_2,
    FolderPath=c_temp_2,
    CsvFileName=_05_rooms_test,
    Point=pt,
    ParameterNames=name,
    ParameterValues=concat_2,
    AreaMode=2)  # -> Output, Data
panel_3 = Panel(rooms_areas.Output)
panel_4 = Panel(rooms_areas.Data)

# ----
# Grids
_20_2 = Number(20)
toggle_3 = BooleanToggle(True)
c_temp_3 = Text("C:\Temp")
_02a_grids_test_v = Text("02A Grids Test V")
_02b_grids_test_h = Text("02B Grids Test H")
_220 = Number(240)
series_3 = Series(Start=_20_2, Step=_20_2, Count=10)
pt_2 = ConstructPoint(XCoordinate=series_3, YCoordinate=_220, ZCoordinate=0)  # -> graft(Point)
pt_3 = ConstructPoint(XCoordinate=series_3, YCoordinate=0, ZCoordinate=0)  # -> graft(Point)
pt_4 = ConstructPoint(XCoordinate=_220, YCoordinate=series_3, ZCoordinate=0)  # -> graft(Point)
pt_5 = ConstructPoint(XCoordinate=0, YCoordinate=series_3, ZCoordinate=0)  # -> graft(Point)
ln = Line(StartPoint=pt_4, EndPoint=pt_5)
ln_2 = Line(StartPoint=pt_2, EndPoint=pt_3)
grids = Grids(WriteToggle=toggle_3, FolderPath=c_temp_3, CsvFileName=_02a_grids_test_v, Curves=ln_2)  # -> Output, Data
grids_2 = Grids(WriteToggle=toggle_3, FolderPath=c_temp_3, CsvFileName=_02b_grids_test_h, Curves=ln)  # -> Output, Data
panel_5 = Panel(grids.Output)
panel_6 = Panel(grids.Data)
panel_7 = Panel(grids_2.Output)
panel_8 = Panel(grids_2.Data)

# ----
# Lines
toggle_4 = BooleanToggle(True)
c_temp_4 = Text("C:\Temp")
_20_3 = Number(20)
_9_2 = Number(9)
_8 = Number(8)
_04_lines_test = Text("04 Lines Test")
_30_2 = Number(30)
series_4 = Series(Start=_30_2, Step=_20_3, Count=_9_2)
subtraction = Subtraction(A=series_4, B=_8)
addition = Addition(A=series_4, B=_8)
pt_6 = ConstructPoint(XCoordinate=subtraction, YCoordinate=addition, ZCoordinate=0)  # -> graft(Point)
pt_7 = ConstructPoint(XCoordinate=addition, YCoordinate=addition, ZCoordinate=0)  # -> graft(Point)
pt_8 = ConstructPoint(XCoordinate=subtraction, YCoordinate=subtraction, ZCoordinate=0)  # -> graft(Point)
pt_9 = ConstructPoint(XCoordinate=addition, YCoordinate=subtraction, ZCoordinate=0)  # -> graft(Point)
ln_3 = Line(StartPoint=pt_8, EndPoint=pt_9)
ln_4 = Line(StartPoint=pt_9, EndPoint=pt_7)
ln_5 = Line(StartPoint=pt_7, EndPoint=pt_6)
ln_6 = Line(StartPoint=pt_6, EndPoint=pt_8)
lines = Lines(
    WriteToggle=toggle_4,
    FolderPath=c_temp_4,
    CsvFileName=_04_lines_test,
    Curves=graft([ln_3, ln_4, ln_5, ln_6]),
    LineMode=4)  # -> Output, Data
panel_9 = Panel(lines.Output)
panel_10 = Panel(lines.Data)

_90_0 = Number(-90)

# ----
# Filled Regions
toggle_5 = BooleanToggle(True)
_10 = Number(10)
c_temp_5 = Text("C:\Temp")
_01_filled_regions_test = Text("01 Filled Regions Test")
_20_4 = Number(20)
_80_0 = Number(-80)
mark = Text("Mark")
text = Text("ID: ")
_20_5 = Number(20)
filled_region_1 = Text("Filled region 1")
series_5 = Series(Start=_80_0, Step=_20_5, Count=_20_4)
addition_2 = Addition(A=series_5, B=_10)
pt_10 = ConstructPoint(XCoordinate=_80_0, YCoordinate=addition_2, ZCoordinate=0)  # -> graft(Point)
pt_11 = ConstructPoint(XCoordinate=_90_0, YCoordinate=addition_2, ZCoordinate=0)  # -> graft(Point)
pt_12 = ConstructPoint(XCoordinate=_80_0, YCoordinate=series_5, ZCoordinate=0)  # -> graft(Point)
pt_13 = ConstructPoint(XCoordinate=_90_0, YCoordinate=series_5, ZCoordinate=0)  # -> graft(Point)
true = Boolean(True)
pline = PolyLine(Vertices=[pt_12, pt_13, pt_11, pt_10], Closed=true)
concat_3 = Concatenate(FragmentA=text, FragmentB=series_5)  # -> graft(Result)
# Basic Revit Elements
filledregions = FilledRegions(
    WriteToggle=toggle_5,
    FolderPath=c_temp_5,
    CsvFileName=_01_filled_regions_test,
    RevitTypeName=filled_region_1,
    DataTreeSource=graft(pline),
    ParameterNames=mark,
    ParameterValues=concat_3)  # -> Output, Data
panel_11 = Panel(filledregions.Output)
panel_12 = Panel(filledregions.Data)

# ----
# Columns
toggle_6 = BooleanToggle(True)
_24_x_24 = Text("24\" x 24\"")
rectangular_column = Text("Rectangular Column")
mark_2 = Text("Mark")
c_temp_6 = Text("C:\Temp")
_20_6 = Number(20)
_45_deg = Number(45)
_11_columns_test = Text("11 Columns Test")
_4 = Number(4)
_120 = Number(120)
series_6 = Series(Start=_20_6, Step=_20_6, Count=_4)
Y = UnitY(Factor=series_6)
X = UnitX(Factor=series_6)
crossref = CrossReference(ListA=X, ListB=Y, CrossMode=1)  # -> ListA, ListB
addition_3 = Addition(A=crossref.ListA, B=crossref.ListB)  # -> graft(Result)
pdecon = Deconstruct(Point=addition_3)  # -> XComponent, YComponent, ZComponent
concat_4 = Concatenate(FragmentA=pdecon.XComponent, FragmentB=pdecon.YComponent, JoinSeparator="-")  # -> graft(Result)
columns = Columns(
    WriteToggle=toggle_6,
    FolderPath=c_temp_6,
    CsvFileName=_11_columns_test,
    RevitFamilyName=rectangular_column,
    RevitTypeName=_24_x_24,
    Points=addition_3,
    Height=_120,
    Rotation=_45_deg,
    ParameterNames=mark_2,
    ParameterValues=concat_4,
    ColMode=1)  # -> Output, Data
panel_13 = Panel(columns.Output)
panel_14 = Panel(columns.Data)

# ----
# Floors
toggle_7 = BooleanToggle(True)
c_temp_7 = Text("C:\Temp")
mark_3 = Text("Mark")
_13_floors_test = Text("13 Floors Test")
text_2 = Text("ID: ")
floor_1 = Text("Floor 1")
_15_2 = Number(15)
start_20 = Number(20)
end_200 = Number(200)
series_7 = Series(Start=0, Step=_15_2, Count=10)
pt_14 = ConstructPoint(XCoordinate=start_20, YCoordinate=start_20, ZCoordinate=series_7)  # -> graft(Point)
pt_15 = ConstructPoint(XCoordinate=end_200, YCoordinate=start_20, ZCoordinate=series_7)  # -> graft(Point)
pt_16 = ConstructPoint(XCoordinate=end_200, YCoordinate=end_200, ZCoordinate=series_7)  # -> graft(Point)
pt_17 = ConstructPoint(XCoordinate=start_20, YCoordinate=end_200, ZCoordinate=series_7)  # -> graft(Point)
true_2 = Boolean(True)
pline_2 = PolyLine(Vertices=[pt_14, pt_15, pt_16, pt_17], Closed=true_2)
concat_5 = Concatenate(FragmentA=text_2, FragmentB=series_7)  # -> graft(Result)
floors = Floors(
    WriteToggle=toggle_7,
    FolderPath=c_temp_7,
    CsvFileName=_13_floors_test,
    RevitTypeName=floor_1,
    DataTreeSource=pline_2,
    ParameterNames=mark_3,
    ParameterValues=concat_5)  # -> Output, Data
panel_15 = Panel(floors.Output)
panel_16 = Panel(floors.Data)

# ----
# Curtain Walls
_9_3 = Number(9)
_9_4 = Number(9)
_20_7 = Number(20)
_30_3 = Number(30)
curtain_wall_1 = Text("Curtain Wall 1")
primary_center_group = Number([0.4, 0.6, 0.4, 0.6])
_15_curtwalls_test = Text("15 CurtWalls Test")
_1_5_x_2_5_rectangular = Text("1.5\" x 2.5\" rectangular")
c_temp_8 = Text("C:\Temp")
number = Number(-5)
rectangular_mullion = Text("Rectangular Mullion")
secondary_center_group = Number([0.2, 0.4, 0.6, 0.8])
_15_3 = Number(15)
primary_outer = Number([0.1, 0.9])
_2_5_x_5_rectangular = Text("2.5\" x 5\" rectangular")
primary_mid_group = Number([0.3, 0.5, 0.7])
series_8 = Series(Start=_30_3, Step=_20_7, Count=_9_3)
subtraction_2 = Subtraction(A=series_8, B=_9_4)
addition_4 = Addition(A=series_8, B=_9_4)
pt_18 = ConstructPoint(XCoordinate=subtraction_2, YCoordinate=subtraction_2, ZCoordinate=_15_3)  # -> graft(Point)
pt_19 = ConstructPoint(XCoordinate=addition_4, YCoordinate=subtraction_2, ZCoordinate=_15_3)  # -> graft(Point)
pt_20 = ConstructPoint(XCoordinate=addition_4, YCoordinate=addition_4, ZCoordinate=_15_3)  # -> graft(Point)
pt_21 = ConstructPoint(XCoordinate=subtraction_2, YCoordinate=addition_4, ZCoordinate=_15_3)  # -> graft(Point)
addition_5 = Addition(A=subtraction_2, B=number)
pt_22 = ConstructPoint(XCoordinate=addition_5, YCoordinate=series_8, ZCoordinate=_15_3)  # -> graft(Point)
ln_7 = Line(StartPoint=pt_18, EndPoint=pt_19)
arc = Arc3Pt(PointA=pt_21, PointB=pt_22, PointC=pt_18)  # -> Arc, Plane, Radius
ln_8 = Line(StartPoint=pt_19, EndPoint=pt_20)
ln_9 = Line(StartPoint=pt_20, EndPoint=pt_21)
combine = CombineData(Input0=[ln_7, ln_8, ln_9, arc.Arc])  # -> Result, Index
curtgrids = CurtGrids(PrimaryOffset=primary_outer, MullionFamilyName=rectangular_mullion, MullionTypeName=_2_5_x_5_rectangular, GridMode=2)
curtgrids_2 = CurtGrids(PrimaryOffset=primary_outer, MullionFamilyName=rectangular_mullion, MullionTypeName=_2_5_x_5_rectangular, GridMode=6)
curtgrids_3 = CurtGrids(
    PrimaryOffset=primary_center_group,
    SecondaryOffset=secondary_center_group,
    MullionFamilyName=rectangular_mullion,
    MullionTypeName=_1_5_x_2_5_rectangular,
    GridMode=3)
curtgrids_4 = CurtGrids(
    PrimaryOffset=primary_mid_group,
    MullionFamilyName=rectangular_mullion,
    MullionTypeName=_1_5_x_2_5_rectangular,
    GridMode=6)
lng = ListLength(List=flatten(combine.Result))
combine_2 = CombineData(Input0=[curtgrids, curtgrids_2, curtgrids_4, curtgrids_3])  # -> simplify(Result), Index
dup = DuplicateData(Data=graft(combine_2.Result), Number=lng, Order=True)
flip = FlipMatrix(Data=dup)
curtwalls = CurtWalls(
    WriteToggle=Toggle(True),
    FolderPath=c_temp_8,
    CsvFileName=_15_curtwalls_test,
    Curves=combine.Result,
    RevitTypeName=curtain_wall_1,
    RevitWallHeight=_15_3,
    GridsMullions=flip)  # -> Output, Data
panel_17 = Panel(curtwalls.Data)
panel_18 = Panel(curtwalls.Output)

_40 = Number(40)

# ----
# Adaptive Components
# Adaptive Component
# must exist in model.
toggle_8 = BooleanToggle(True)
_9_5 = Number(9)
c_temp_9 = Text("C:\Temp")
_20_adap_comp_test = Text("20 Adap Comp Test")
_15_4 = Number(15)
adapcomptest = Text("AdapCompTest")
_20_8 = Number(20)
_15_5 = Number(15)
series_9 = Series(Start=0, Step=_15_4, Count=_9_5)
addition_6 = Addition(A=series_9, B=_15_5)
pt_23 = ConstructPoint(XCoordinate=_20_8, YCoordinate=_20_8, ZCoordinate=addition_6)  # -> graft(Point)
pt_24 = ConstructPoint(XCoordinate=_20_8, YCoordinate=_40, ZCoordinate=addition_6)  # -> graft(Point)
pt_25 = ConstructPoint(XCoordinate=_20_8, YCoordinate=_20_8, ZCoordinate=series_9)  # -> graft(Point)
pt_26 = ConstructPoint(XCoordinate=_20_8, YCoordinate=_40, ZCoordinate=series_9)  # -> graft(Point)
text_3 = Text("ID: ")
mark_4 = Text("Mark")
concat_6 = Concatenate(FragmentA=text_3, FragmentB=series_9)  # -> graft(Result)
# Complex Revit Forms
adapcomps = AdapComps(
    WriteToggle=toggle_8,
    FolderPath=c_temp_9,
    CsvFileName=_20_adap_comp_test,
    RevitFamilyName=adapcomptest,
    RevitTypeName=adapcomptest,
    Points=[pt_25, pt_26, pt_24, pt_23],
    ParameterNames=mark_4,
    ParameterValues=concat_6)  # -> Output, Data
panel_19 = Panel(adapcomps.Output)
panel_20 = Panel(adapcomps.Data)

# ----
# Families
# Family must exist
# in model.
toggle_9 = BooleanToggle(True)
c_temp_10 = Text("C:\Temp")
_20_9 = Number(20)
_15_6 = Number(15)
_30_4 = Number(30)
_9_6 = Number(9)
_40_2 = Number(40)
_60_x_30 = Text("60\" x 30\"")
mark_5 = Text("Mark")
text_4 = Text("ID: ")
_21_families_test = Text("21 Families Test")
desk = Text("Desk")
series_10 = Series(Start=_30_4, Step=_20_9, Count=_9_6)
mod = Modulus(A=series_10, B=_40_2)
pt_27 = ConstructPoint(XCoordinate=series_10, YCoordinate=series_10, ZCoordinate=0)  # -> graft(Point)
larger = LargerThan(FirstNumber=mod, SecondNumber=_15_6)  # -> LargerThan, OrEqualTo
concat_7 = Concatenate(FragmentA=text_4, FragmentB=series_10)  # -> graft(Result)
_2 = Number(2)
division = Division(A=series_10, B=_2)
families = Families(
    WriteToggle=toggle_9,
    FolderPath=c_temp_10,
    CsvFileName=_21_families_test,
    RevitFamilyName=desk,
    RevitTypeName=_60_x_30,
    Point=pt_27,
    Rotate=division,
    MirrorX=larger.LargerThan,
    ParameterNames=mark_5,
    ParameterValues=concat_7)  # -> Output, Data
panel_21 = Panel(families.Data)
panel_22 = Panel(families.Output)

# ----
# Loft Forms
# (Must be run in Conceptual Mass Family)
# Points
# Lines
# Surface
series_11 = Series(Start=0, Step=1, Count=10)
toggle_10 = BooleanToggle(True)
c_temp_11 = Text("C:\Temp")
_22a_loft_forms_test_points = Text("22A Loft Forms Test - Points")
_10_2 = Number(10)
_20_10 = Number(20)
_30_5 = Number(30)
_22b_loft_forms_test_lines = Text("22B Loft Forms Test - Lines")
_22c_loft_forms_test_surface = Text("22C Loft Forms Test - Surface")
sin = Sine(Value=series_11)
_10_3 = Number(10)
_10_4 = Number(10)
multiplication = Multiplication(A=series_11, B=_10_3)
multiplication_2 = Multiplication(A=sin, B=_10_4)
pt_28 = ConstructPoint(XCoordinate=multiplication, YCoordinate=_30_5, ZCoordinate=multiplication_2)
pt_29 = ConstructPoint(XCoordinate=multiplication, YCoordinate=_20_10, ZCoordinate=multiplication_2)
pt_30 = ConstructPoint(XCoordinate=multiplication, YCoordinate=0, ZCoordinate=multiplication_2)
pt_31 = ConstructPoint(XCoordinate=multiplication, YCoordinate=_10_2, ZCoordinate=multiplication_2)
entwine = Entwine(Branch0X=pt_29, Branch1X=pt_28, FlattenInputs=False)
loftforms = LoftForms(WriteToggle=toggle_10, FolderPath=c_temp_11, CsvFileName=_22a_loft_forms_test_points, Points=pt_30, LoftMode=1)  # -> Output, Data
loftforms_2 = LoftForms(WriteToggle=toggle_10, FolderPath=c_temp_11, CsvFileName=_22c_loft_forms_test_surface, Points=entwine, LoftMode=3)  # -> Output, Data
loftforms_3 = LoftForms(WriteToggle=toggle_10, FolderPath=c_temp_11, CsvFileName=_22b_loft_forms_test_lines, Points=pt_31, LoftMode=2)  # -> Output, Data
panel_23 = Panel(loftforms.Data)
panel_24 = Panel(loftforms.Output)
panel_25 = Panel(loftforms_3.Output)
panel_26 = Panel(loftforms_3.Data)
panel_27 = Panel(loftforms_2.Output)
panel_28 = Panel(loftforms_2.Data)

# ----
# Mass Families
# Family template must be specified in ModelBuilder.
# 
# Family name will be used as root to create new family instances.
toggle_11 = BooleanToggle(True)
c_temp_12 = Text("C:\Temp")
_23_massfamiliestest = Text("23 MassFamiliesTest")
_10_5 = Number(10)
_8_2 = Number(8)
_9_7 = Number(9)
_39 = Number(39)
_25 = Number(25)
generic_model = Text("Generic Model")
_21 = Number(21)
series_12 = Series(Start=_25, Step=_10_5, Count=_8_2)
subtraction_3 = Subtraction(A=series_12, B=_9_7)
addition_7 = Addition(A=series_12, B=_9_7)
pt_32 = ConstructPoint(XCoordinate=subtraction_3, YCoordinate=_39, ZCoordinate=0)  # -> graft(Point)
pt_33 = ConstructPoint(XCoordinate=addition_7, YCoordinate=_39, ZCoordinate=0)  # -> graft(Point)
pt_34 = ConstructPoint(XCoordinate=subtraction_3, YCoordinate=_21, ZCoordinate=0)  # -> graft(Point)
pt_35 = ConstructPoint(XCoordinate=addition_7, YCoordinate=_21, ZCoordinate=0)  # -> graft(Point)
true_3 = Boolean(True)
pt_36 = ConstructPoint(XCoordinate=series_12, YCoordinate=0, ZCoordinate=0)
pline_3 = PolyLine(Vertices=[pt_34, pt_35, pt_33, pt_32], Closed=true_3)
mark_6 = Text("Mark")
text_5 = Text("ID: ")
concat_8 = Concatenate(FragmentA=text_5, FragmentB=series_12)  # -> graft(Result)
massfamilies = MassFamilies(
    WriteToggle=toggle_11,
    FolderPath=c_temp_12,
    CsvFileName=_23_massfamiliestest,
    FamilyName=generic_model,
    Profile=pline_3,
    InsertionPoint=pt_36,
    Height=series_12,
    ParameterNames=mark_6,
    ParameterValues=concat_8)  # -> Output, Data
panel_29 = Panel(massfamilies.Output)
panel_30 = Panel(massfamilies.Data)

# ----
# Topo Surfaces
toggle_12 = BooleanToggle(True)
c_temp_13 = Text("C:\Temp")
_4_2 = Number(4)
number_2 = Number(-80)
number_3 = Number(-60)
_24_toposurfacestest = Text("24 TopoSurfacesTest")
_20_11 = Number(20)
series_13 = Series(Start=number_2, Step=_20_11, Count=_20_11)
Y_2 = UnitY(Factor=series_13)
X_2 = UnitX(Factor=series_13)
crossref_2 = CrossReference(ListA=X_2, ListB=Y_2, CrossMode=1)  # -> ListA, ListB
addition_8 = Addition(A=crossref_2.ListA, B=crossref_2.ListB)
pdecon_2 = Deconstruct(Point=addition_8)  # -> XComponent, YComponent, ZComponent
lng_2 = ListLength(List=addition_8)
_0_001 = Number(0.001)
multiplication_3 = Multiplication(A=pdecon_2.XComponent, B=pdecon_2.YComponent)
multiplication_4 = Multiplication(A=multiplication_3, B=_0_001)
sin_2 = Sine(Value=multiplication_4)
multiplication_5 = Multiplication(A=sin_2, B=_4_2)
number_4 = Number(0.1)
addition_9 = Addition(A=pdecon_2.XComponent, B=pdecon_2.YComponent)
multiplication_6 = Multiplication(A=addition_9, B=number_4)
addition_10 = Addition(A=multiplication_6, B=multiplication_5)
addition_11 = Addition(A=addition_10, B=number_3)
Z = UnitZ(Factor=addition_11)
addition_12 = Addition(A=addition_8, B=Z)  # -> flatten(Result)
toposurface = TopoSurface(WriteToggle=toggle_12, FolderPath=c_temp_13, CsvFileName=_24_toposurfacestest, Point=flatten(addition_12))  # -> Output, Data
panel_31 = Panel(toposurface.Output)
panel_32 = Panel(toposurface.Data)

# ----
# Input
toggle_13 = BooleanToggle(True)
c_temp_14 = Text("C:\Temp")
inputtest = Text("InputTest")
input = Input(
    ReadToggle=toggle_13,
    FolderPath=c_temp_14,
    CsvFileName=inputtest,
    AddGeometryPoints=Toggle(True),
    AddGeometryCurves=Toggle(True),
    AddGeometrySurfaces=Toggle(True))  # -> Output, Points, Curves, Surfaces
panel_33 = Panel(input.Output)
# Input
panel_34 = Panel(input.Points)
panel_35 = Panel(input.Curves)
panel_36 = Panel(input.Surfaces)

# ----
# Beams
toggle_14 = BooleanToggle(True)
c_temp_15 = Text("C:\Temp")
_16_x_32 = Text("16 x 32")
_10_beams_test = Text("10 Beams Test")
start_20_2 = Number(20)
concrete_rectangular_beam = Text("Concrete-Rectangular Beam")
end_200_2 = Number(200)
_20_12 = Number(20)
mark_7 = Text("Mark")
text_6 = Text("ID: ")
_45_deg_2 = Number(45)
series_14 = Series(Start=_20_12, Step=_20_12, Count=10)
pt_37 = ConstructPoint(XCoordinate=end_200_2, YCoordinate=series_14, ZCoordinate=0)  # -> graft(Point)
pt_38 = ConstructPoint(XCoordinate=start_20_2, YCoordinate=series_14, ZCoordinate=0)  # -> graft(Point)
concat_9 = Concatenate(FragmentA=text_6, FragmentB=series_14)  # -> graft(Result)
weave = Weave(Pattern=[0, 1], Stream0=pt_38, Stream1=pt_37, NullGaps=False)

# ----
# Simple Revit Forms
beams = Beams(
    WriteToggle=toggle_14,
    FolderPath=c_temp_15,
    CsvFileName=_10_beams_test,
    RevitFamilyName=concrete_rectangular_beam,
    RevitTypeName=_16_x_32,
    Points=weave,
    Rotations=_45_deg_2,
    ParameterNames=mark_7,
    ParameterValues=concat_9)  # -> Output, Data

panel_37 = Panel(beams.Data)
panel_38 = Panel(beams.Output)

# ----
# Walls
toggle_15 = BooleanToggle(True)
c_temp_16 = Text("C:\Temp")
_14_walls_test = Text("14 Walls Test")
_20_13 = Number(20)
_9_8 = Number(9)
_9_9 = Number(9)
number_5 = Number(-5)
_30_6 = Number(30)
series_15 = Series(Start=_30_6, Step=_20_13, Count=_9_8)
addition_13 = Addition(A=series_15, B=_9_9)
pt_39 = ConstructPoint(XCoordinate=addition_13, YCoordinate=addition_13, ZCoordinate=0)  # -> graft(Point)
generic_8 = Text("Generic - 8\"")
heights = Number([2, 4, 6, 8, 10, 12, 14, 12, 10])
_4_3 = Number(4)
stack = StackData(Data=heights, Stack=_4_3)

subtraction_4 = Subtraction(A=series_15, B=_9_9)

addition_14 = Addition(A=subtraction_4, B=number_5)
pt_40 = ConstructPoint(XCoordinate=subtraction_4, YCoordinate=addition_13, ZCoordinate=0)  # -> graft(Point)
pt_41 = ConstructPoint(XCoordinate=subtraction_4, YCoordinate=subtraction_4, ZCoordinate=0)  # -> graft(Point)
pt_42 = ConstructPoint(XCoordinate=addition_13, YCoordinate=subtraction_4, ZCoordinate=0)  # -> graft(Point)
pt_43 = ConstructPoint(XCoordinate=addition_14, YCoordinate=series_15, ZCoordinate=0)  # -> graft(Point)
arc_2 = Arc3Pt(PointA=pt_40, PointB=pt_43, PointC=pt_41)  # -> Arc, Plane, Radius
ln_10 = Line(StartPoint=pt_41, EndPoint=pt_42)
ln_11 = Line(StartPoint=pt_42, EndPoint=pt_39)
ln_12 = Line(StartPoint=pt_39, EndPoint=pt_40)

walls = Walls(
    WriteToggle=toggle_15,
    FolderPath=c_temp_16,
    CsvFileName=_14_walls_test,
    Curves=[ln_10, ln_11, ln_12, arc_2.Arc],
    RevitTypeName=generic_8,
    RevitWallHeights=stack)  # -> Output, Data

panel_39 = Panel(walls.Output)
panel_40 = Panel(walls.Data)
