# Grasshopper definition Simple Example.gh (Grasshopper 1.0.7)
# plug-ins: Hummingbird

# ----
# Source
# Geometry
crv = Curve(<curve referenced from the Rhino model>)
brep = Brep([<brep referenced from the Rhino model> x2])
explode = Explode(Curve=crv, Recursive=True)  # -> graft(Segments), Vertices
join = BrepJoin(Breps=brep)  # -> Breps, Closed

# ----
# Extents
bbox = BoundingBox(Content=join.Breps, Plane=PlaneXY(0, 0, 0))  # -> Box, Box_2
box = BoxComponents(Box=bbox.Box)  # -> Plane, X, Y, Z
domcomp = DomainComponents(Domain=box.Z)  # -> Start, End

# ----
# Horizontal Sections
no_of_levels = Integer(5)
range = Range(Domain=box.Z, Steps=no_of_levels)
Z = UnitZ(Factor=range)
xy = XYPlane(Origin=Z)
dedomain = DeconstructDomain(Domain=box.Z)  # -> Start, End
sec = BrepPlane(Brep=join.Breps, Plane=xy)  # -> Curves, Points
division = Division(A=dedomain.End, B=no_of_levels)

# ----
# Column Points
edge_offset = Slider(0.8, range=0..1)
# Default column type must be set in ModelBuilder.
no_of_divisions = Slider(10, range=1..100)
area = Area(Geometry=sec.Curves)  # -> Area, Centroid
scale_nu = ScaleNU(Geometry=sec.Curves, Plane=area.Centroid, ScaleX=edge_offset, ScaleY=edge_offset, ScaleZ=1)  # -> Geometry, Transform
divide = DivideCurve(Curve=scale_nu.Geometry, Count=no_of_divisions, Kinks=False)  # -> flatten(Points), Tangents, Parameters

output_folder = Text("C:\Temp")

# ----
# Floors
button = Button()
floor = Floor(WriteToggle=button, ExcelPath=output_folder, DataTreeSource=sec.Curves)  # -> Output, Data

# ----
# Walls
button_2 = Button()
walls = Walls(WriteToggle=button_2, FolderPath=output_folder, Curves=explode.Segments, RevitWallHeights=domcomp.End)  # -> Output, Data

# ----
# Columns
button_3 = Button()
column = Column(WriteToggle=button_3, ExcelPath=output_folder, Points=graft(divide.Points), Height=division, ColMode=1)  # -> Output, Data
